# Grasshopper definition model_brigade_douanes.gh (Grasshopper 1.0.8)

searchconstrs = HBSearchConstructions(keywords="wall")  # -> opaque_constrs, window_constrs, shade_constrs; plug-in component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
panel = Panel(searchconstrs.opaque_constrs)
item = ListItem(List=panel, Index="756", Wrap=True)

searchconstrs_2 = HBSearchConstructions(keywords="roof")  # -> opaque_constrs, window_constrs, shade_constrs; plug-in component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
panel_2 = Panel(searchconstrs_2.opaque_constrs)
item_2 = ListItem(List=panel_2, Index="1", Wrap=True)

searchconstrs_3 = HBSearchConstructions(keywords="floor")  # -> opaque_constrs, window_constrs, shade_constrs; plug-in component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
panel_3 = Panel(searchconstrs_3.opaque_constrs)
item_3 = ListItem(List=panel_3, Index="2", Wrap=True)

# ----
# Construction Sets
panel_4 = Panel("window")
searchconstrs_4 = HBSearchConstructions(keywords=panel_4)  # -> opaque_constrs, window_constrs, shade_constrs; plug-in component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
panel_5 = Panel(searchconstrs_4.window_constrs)
item_4 = ListItem(List=panel_5, Index="3", Wrap=True)
panel_6 = Panel(item_4)
subfacesubset = HBSubfaceSubset(window=item_4)  # -> subface_set; plug-in component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
exteriorsubset = HBExteriorConstructionSubset(exterior_wall=item, exterior_roof=item_2, exposed_floor=item_3)  # -> exterior_set; plug-in component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
constructionset = HBConstructionSet(exterior_subset=exteriorsubset, subface_subset=subfacesubset)  # -> constr_set; plug-in component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
decnstrconstr = HBDeconstructConstruction(constr=panel_6)  # -> materials, layers, r_val_si, r_val_ip, u_fac_si, u_fac_ip, shgc, t_sol, t_vis; plug-in component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
panel_7 = Panel(decnstrconstr.materials)

brep = Brep(<brep referenced from the Rhino model>)
bldgprograms = HBBuildingPrograms({"LargeOffice", "MediumOffice", "SmallOffice", "MidriseApartment", "HighriseApartment", "Retail", "StripMall", "PrimarySchool", "SecondarySchool", "SmallHotel", "LargeHotel", "Hospital", "Outpatient", "Laboratory", "Warehouse", "SuperMarket", "FullServiceRestaurant", "QuickServiceRestaurant", "Courthouse", "College", "LargeDataCenterHighITE", "LargeDataCenterLowITE", "SmallDataCenterHighITE", "SmallDataCenterLowITE"}, selected="MediumOffice")
# Geometry
brep_2 = Brep(<brep referenced from the Rhino model>)
intsolid = HBIntersectSolids(rooms=flatten([brep_2, brep]), run=Toggle(True))  # -> int_rooms; plug-in component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
roomsolid = HBRoomFromSolid(geo=flatten(intsolid), constr_set=constructionset, program=bldgprograms, conditioned="False")  # -> report, rooms; plug-in component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
aperturesbyratio = HBAperturesByRatio(hb_objs=flatten(roomsolid.rooms), ratio=Slider(0.5, range=0..1), subdivide="False", sill_height="3", operable="True")  # -> report, hb_objs; plug-in component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
vizbytype = HBVisualizeByType(hb_objs=aperturesbyratio.hb_objs)  # -> walls, interior_walls, roofs, ceilings, exterior_floors, interior_floors, air_walls, apertures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; plug-in component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

# ----
# Weather
panel_8 = Panel("https://climate.onebuilding.org/WMO_Region_1_Africa/SEN_Senegal/SEN_MT_Matam.616300_TMYx.zip")
downloadepw = LBDownloadWeather(weather_URL=panel_8)  # -> epw_file, stat_file, ddy_file; plug-in component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
importepw = LBImportEPW(epw_file=downloadepw.epw_file)  # -> location, dry_bulb_temperature, dew_point_temperature, relative_humidity, wind_speed, wind_direction, direct_normal_rad, diffuse_horizontal_rad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; plug-in component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

pt = Point(<point referenced from the Rhino model>)
model = HBModel(rooms=flatten(aperturesbyratio.hb_objs))  # -> report, model; plug-in component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

# ----
# Simulation Parameters
panel_9 = Panel("True")
simoutput = HBSimulationOutput(
    zone_energy_use=panel_9,
    gains_and_losses=panel_9,
    comfort_metrics=panel_9,
    surface_temperature=panel_9,
    surface_energy_flow=panel_9)  # -> report, sim_output; plug-in component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
sizingpar = HBSizingParameter()  # -> sizing; plug-in component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
simpar = HBSimulationParameter(output=simoutput.sim_output, timestep=6, sizing=sizingpar)  # -> sim_par; plug-in component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

psychrometricchart = LBPsychrometricChart(temperature=importepw.dry_bulb_temperature, rel_humidity=importepw.relative_humidity, base_pt=pt)  # -> report, title, temp_lines, rh_lines, hr_lines, enth_wb_lines, mesh, legend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; plug-in component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

# ----
# Outdoor Comfort Analysis
panel_10 = Panel("https://climate.onebuilding.org/WMO_Region_1_Africa/SEN_Senegal/SEN_DK_Dakar-Senghor.Intl.AP.616410_TMYx.zip")
panel_11 = Panel("https://climate.onebuilding.org/WMO_Region_1_Africa/SEN_Senegal/SEN_MT_Matam.616300_TMYx.zip")
downloadepw_2 = LBDownloadWeather(weather_URL=panel_10)  # -> epw_file, stat_file, ddy_file; plug-in component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
downloadepw_3 = LBDownloadWeather(weather_URL=panel_11)  # -> epw_file, stat_file, ddy_file; plug-in component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
importepw_2 = LBImportEPW(epw_file=downloadepw_2.epw_file)  # -> location, dry_bulb_temperature, dew_point_temperature, relative_humidity, wind_speed, wind_direction, direct_normal_rad, diffuse_horizontal_rad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; plug-in component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
importepw_3 = LBImportEPW(epw_file=downloadepw_3.epw_file)  # -> location, dry_bulb_temperature, dew_point_temperature, relative_humidity, wind_speed, wind_direction, direct_normal_rad, diffuse_horizontal_rad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; plug-in component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
utci = LBUTCIComfort(air_temp=importepw_2.dry_bulb_temperature, rel_humid=importepw_2.relative_humidity, run=Toggle(True))  # -> report, utci, comfort, condition, category, comf_obj; plug-in component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
utci_2 = LBUTCIComfort(air_temp=importepw_3.dry_bulb_temperature, rel_humid=importepw_3.relative_humidity, run=Toggle(True))  # -> report, utci, comfort, condition, category, comf_obj; plug-in component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
panel_12 = Panel(utci.utci)
panel_13 = Panel(utci_2.comf_obj)
analysisperiod = LBAnalysisPeriod(start_month=1, start_day=1, start_hour=0)  # -> period, hoys, dates; plug-in component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
analysisperiod_2 = LBAnalysisPeriod(start_month=1, start_day=1, start_hour=0)  # -> period, hoys, dates; plug-in component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
pt_2 = Point(<point referenced from the Rhino model>)
pt_3 = Point(<point referenced from the Rhino model>)
hourlyplot = LBHourlyPlot(data=utci.category, base_pt=pt_2, period=analysisperiod.period)  # -> report, mesh, legend, borders, labels, title, vis_set; plug-in component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
hourlyplot_2 = LBHourlyPlot(data=utci_2.category, base_pt=pt_3, period=analysisperiod_2.period)  # -> report, mesh, legend, borders, labels, title, vis_set; plug-in component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
preview = CustomPreview(Geometry=[hourlyplot.legend, hourlyplot.borders], Material=ColourSwatch(SwatchColor=RGB(0, 0, 0)))
preview_2 = CustomPreview(Geometry=[hourlyplot_2.legend, hourlyplot_2.borders], Material=ColourSwatch(SwatchColor=RGB(0, 0, 0)))

toggle = BooleanToggle(True)
modeltoosm = HBModelToOSM(model=model.model, epw_file=downloadepw.epw_file, sim_par=simpar, write=toggle, run=toggle)  # -> report, jsons, osw, osm, idf, sql, zsz, rdd, html; plug-in component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
comfstat = LBComfortStatistics(comf_obj=utci.comf_obj)  # -> pct_hot, pct_neutral, pct_cold; plug-in component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
comfstat_2 = LBComfortStatistics(comf_obj=utci_2.comf_obj)  # -> pct_hot, pct_neutral, pct_cold; plug-in component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
panel_14 = Panel(modeltoosm.report)
pt_4 = Point(<point referenced from the Rhino model>)

eui = HBEndUseIntensity(sql=modeltoosm.sql)  # -> eui, eui_end_use, end_uses, gross_floor; plug-in component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
cei = HBCarbonEmissionIntensity(sql=modeltoosm.sql, loc_kgMWh="560")  # -> cei, cei_end_use, end_uses, gross_floor; plug-in component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
# Results
roomcomfortresult = HBReadRoomComfortResult(sql=modeltoosm.sql)  # -> oper_temp, air_temp, rad_temp, rel_humidity, unmet_heat, unmet_cool; plug-in component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
panel_15 = Panel(cei.cei)
timeop = LBTimeIntervalOperation(data=roomcomfortresult.oper_temp)  # -> daily, monthly, mon_per_hr; plug-in component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
monthlychart = LBMonthlyChart(data=timeop.mon_per_hr, base_pt=pt_4)  # -> report, data_mesh, data_lines, col_lines, legend, borders, labels, y_title, title, vis_set; plug-in component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

panel_16 = Panel(eui.end_uses)

# ----
# Indoor Comfort Analysis
pmv = LBPMVComfort(air_temp=roomcomfortresult.air_temp, rel_humid=roomcomfortresult.rel_humidity, run=Toggle(True))  # -> report, pmv, ppd, set, comfort, condition, heat_loss, comf_obj; plug-in component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
adaptive = LBAdaptiveComfort(out_temp=importepw.dry_bulb_temperature, air_temp=roomcomfortresult.air_temp, run=Toggle(True))  # -> report, prevail_temp, neutral_temp, deg_neutral, comfort, condition, comf_obj; plug-in component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
panel_17 = Panel(pmv.ppd)
panel_18 = Panel(adaptive.prevail_temp)
pt_5 = Point(<point referenced from the Rhino model>)
pt_6 = Point(<point referenced from the Rhino model>)
hourlyplot_3 = LBHourlyPlot(data=pmv.pmv, base_pt=pt_5)  # -> report, mesh, legend, borders, labels, title, vis_set; plug-in component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
hourlyplot_4 = LBHourlyPlot(data=adaptive.condition, base_pt=pt_6)  # -> report, mesh, legend, borders, labels, title, vis_set; plug-in component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
